# Grasshopper definition GH_FILE.gh (Grasshopper 1.0.7)
# plug-ins: Hops

concatenate = Concatenate(FragmentA="http://127.0.0.1:5000", FragmentB="/pointat")
curve = Curve(<curve referenced from the Rhino model>)
hops = Hops(
    _Path=concatenate,
    Curve=reparameterize(curve),
    T=Slider(0.58, range=0..1),
    CacheResultsInMemory=True,
    CacheSolveResults=True,
    RemoteDefinitionLocation="http://127.0.0.1:5000/pointat",
    RemoteSolveVersion=(0, 1, 0),
    ShowInput_Enabled=False,
    ShowInput_Path=True,
    SynchronousSolve=True)
panel = Panel(hops)
concatenate_2 = Concatenate(FragmentA="http://127.0.0.1:5000", FragmentB="/spheresFromPt")

concatenate_3 = Concatenate(FragmentA="http://127.0.0.1:5000", FragmentB="/createGraph")
hops_2 = Hops(
    _Path=concatenate_3,
    CountX=Slider(6, range=0..10),
    CountY=Slider(8, range=0..10),
    Layout=Slider(1, range=0..10),
    CacheResultsInMemory=True,
    CacheSolveResults=True,
    RemoteDefinitionLocation="http://127.0.0.1:5000/createGraph",
    RemoteSolveVersion=(0, 1, 0),
    ShowInput_Enabled=False,
    ShowInput_Path=True,
    SynchronousSolve=True)  # -> Nodes, Edges
hops_3 = Hops(
    _Path=concatenate_2,
    Centers=hops,
    Radius=Slider(3.37, range=0..10),
    CacheResultsInMemory=True,
    CacheSolveResults=True,
    RemoteDefinitionLocation="http://127.0.0.1:5000/spheresFromPt",
    RemoteSolveVersion=(0, 1, 0),
    ShowInput_Enabled=False,
    ShowInput_Path=True,
    SynchronousSolve=True)
ghpython_script = GhPythonScript(seed=Slider(2, range=0..10), time=Slider(1636, range=0..10000))  # -> out, a; inputs seed: Int32, time: Int32
# ---------- ghpython_script: Python ----------
import rhinoscriptsyntax as rs
import random as r

r.seed(seed)

#class

class Walker:
    
    def __init__(self):
        self.x = 0
        self.y = 0
        self.z = 0
        
    def point(self):
        shape = rs.AddPoint(self.x,self.y,self.z)
        return shape
        
    def step (self):
        stepX = r.randint(-1,1)
        stepY = r.randint(-1,1)
        stepZ = r.randint(-1,1)
        
        self.x += stepX
        self.y += stepY
        self.z += stepZ


#time

w = Walker()

pList = []
for t in range(time):
    w.step()
    pList.append(w.point())
    

a = pList
# ---------- end ghpython_script ----------
panel_2 = Panel(ghpython_script.a)
